# Dynamo graph Path of Travel Adjacency Analysis.dyn (Dynamo 2.3.0.5885)
# packages: Data-Shapes 2019.2.42

# group: Package Info
# note: Script Name: Path of Travel Adjacency Analysis.dyn
# Packages used in this script:
# Data-Shapes version: 2019.2.42
# TimeStamp : 2020/1/24 9:32

# group: Getting All Rooms
code_block = CodeBlock { "Rooms"; }
byName = Category.ByName(name=code_block)
code_block_2 = CodeBlock { doc = Document.Current; activeView = Document.ActiveView(doc); }
all_elements_of_category_in_view = ElementsOfCategoryInView(Category=byName, View=code_block_2.activeView)
code_block_3 = CodeBlock(rooms=all_elements_of_category_in_view) { template = rooms[0]; }
parameters = Element.Parameters(element=code_block_3)
name = Parameter.Name(parameter=parameters)

code_block_4 = CodeBlock { "Parameter Name for Analysis Codes"; }
code_block_5 = CodeBlock { 0; true; }
data_shapes_ui_dropdown_data = Custom[Data-Shapes_UI.DropDown Data](InputName=code_block_4, Keys=name, Values=name, DefaultValueIndex=code_block_5.out0, Sorted_optional=code_block_5.out1)  # package Data-Shapes; Create data for DropDown input in UI.MultiInputForm ++ . Check out www.data-shapes.net for more infos.
code_block_6 = CodeBlock { "Parameter Name for Analysis Output"; }
code_block_7 = CodeBlock { 0; true; }
data_shapes_ui_dropdown_data_2 = Custom[Data-Shapes_UI.DropDown Data](InputName=code_block_6, Keys=name, Values=name, DefaultValueIndex=code_block_7.out0, Sorted_optional=code_block_7.out1)

# group: Interface to Set Parameters
code_block_8 = CodeBlock { "Select parameters that you would like to use for the analysis"; }
file_path = Filename("..\..\..\00_Templates and Processes\CGA Assets\CGA Logo Image.jpg")
code_block_9 = CodeBlock { "Select Parameters"; }
list_create = List.Create(item0=data_shapes_ui_dropdown_data, item1=data_shapes_ui_dropdown_data_2)
boolean = BoolSelector(true)
code_block_10 = CodeBlock { 700; }
data_shapes_ui_multipleinputform = Custom[Data-Shapes_UI.MultipleInputForm ++](Description_optional=code_block_8, Logo_optional=file_path, ButtonText_optional=code_block_9, Inputs=list_create, Toggle=boolean, Width_optional=code_block_10)  # package Data-Shapes; Create a form with multiple inputs. see www.data-shapes.net for tutorials and infos!
code_block_11 = CodeBlock(previousOUT=code_block_2.activeView, paramsOUT=data_shapes_ui_multipleinputform.User_Inputs, RoomsIn=all_elements_of_category_in_view)
# ---------- code_block_11.designscript (6 lines) ----------
AnalysisView = DSCore.List.Flatten(previousOUT,-1);
AnalysisCode = DSCore.List.Flatten(paramsOUT[0],-1);
AnalysisOutput = DSCore.List.Flatten(paramsOUT[1],-1);
RoomsThrough = DSCore.List.Flatten(RoomsIn,-1);

packagedOUT = [AnalysisView,AnalysisCode,AnalysisOutput,RoomsThrough];
# ----------------------------------------

# group: Unique Codes
getParameterValueByName = Element.GetParameterValueByName(element=all_elements_of_category_in_view, parameterName=code_block_11.AnalysisCode@L1)
flatten = List.Flatten(list=getParameterValueByName)
uniqueItems = List.UniqueItems(list=flatten)
python_script = Python(IN[0]=uniqueItems)
# ---------- python_script.python (8 lines) ----------
DataIn=IN[0]

listOut = []

for item in DataIn:
	if item:
		listOut.append(item)
OUT = listOut
# ----------------------------------------

# group: Start Rooms
code_block_12 = CodeBlock { "Parameter Code for Start Rooms"; 0; true; }
ui_dropdown_data = Custom[UI.DropDown Data](InputName=code_block_12.out0, Keys=python_script, Values=python_script, DefaultValueIndex=code_block_12.out1, Sorted_optional=code_block_12.out2)  # package Data-Shapes; Create data for DropDown input in UI.MultiInputForm ++ . Check out www.data-shapes.net for more infos.

# group: Destination Rooms
code_block_13 = CodeBlock { "Parameter Code for Destination Rooms"; 0; true; }
ui_dropdown_data_2 = Custom[UI.DropDown Data](InputName=code_block_13.out0, Keys=python_script, Values=python_script, DefaultValueIndex=code_block_13.out1, Sorted_optional=code_block_13.out2)

# group: Delete Existing Paths
code_block_14 = CodeBlock()
# ---------- code_block_14.designscript (4 lines) ----------
"Check the box if you would like to delete all existing paths of travel before running this analysis";
false;
"Delete Existing Travel Paths";
true;
# ----------------------------------------
data_shapes_ui_boolean_input = Custom[Data-Shapes_UI.Boolean input](InputName=code_block_14.out0, DefaultValue=code_block_14.out1, SideText=code_block_14.out2)  # package Data-Shapes; Creates a boolean input for UI.MultipleInputForm ++ . Check out www.data-shapes.net for more infos!

# group: Draw Only Shortest Path
code_block_15 = CodeBlock { "Check the box if you would like to only draw the paths to the nearest destination"; false; "Shortest Paths"; true; }
data_shapes_ui_boolean_input_2 = Custom[Data-Shapes_UI.Boolean input](InputName=code_block_15.out0, DefaultValue=code_block_15.out1, SideText=code_block_15.out2)

# group: Interface to Set Analysis Codes
code_block_16 = CodeBlock { "Select parameters that you would like to use for the analysis"; }
file_path_2 = Filename("..\..\..\00_Templates and Processes\CGA Assets\CGA Logo Image.jpg")
list_create_2 = List.Create(item0=ui_dropdown_data, item1=ui_dropdown_data_2, item2=data_shapes_ui_boolean_input, item3=data_shapes_ui_boolean_input_2)
code_block_17 = CodeBlock { 700; }
ui_multipleinputform = Custom[UI.MultipleInputForm ++](Description_optional=code_block_16, Logo_optional=file_path_2, Inputs=list_create_2, Toggle=data_shapes_ui_multipleinputform.Was_Run, Width_optional=code_block_17)  # package Data-Shapes; Create a form with multiple inputs. see www.data-shapes.net for tutorials and infos!
code_block_18 = CodeBlock(OUT=ui_multipleinputform.User_Inputs, PreviousOUT=code_block_11.packagedOUT)
# ---------- code_block_18.designscript (9 lines) ----------
startCode = [OUT[0]];
endCode = [OUT[1]];
analysisView = PreviousOUT[0];
analysisCodeParam = PreviousOUT[1];
analysisOutputParam = PreviousOUT[2];
roomsThrough = PreviousOUT[3];
deleteExistingPaths = OUT[2];
drawOnlyShortestPaths = OUT[3];
CumulativeOUT = [startCode,endCode,analysisView,analysisCodeParam,analysisOutputParam, roomsThrough];
# ----------------------------------------
code_block_19 = CodeBlock { "Run Analysis"; }

# group: Filter Room Data By Parameter Values
getParameterValueByName_2 = Element.GetParameterValueByName(element=code_block_18.roomsThrough, parameterName=code_block_18.analysisCodeParam@L1)
code_block_20 = CodeBlock(paramVal=getParameterValueByName_2, startVal=code_block_18.startCode, endVal=code_block_18.endCode)
# ---------- code_block_20.designscript (3 lines) ----------
isStartPoint = paramVal == startVal;
isEndPoint = paramVal == endVal;
includedInAnalysis = DSCore.List.Flatten(isStartPoint || isEndPoint,-1);
# ----------------------------------------

# group: Pairing Down Rooms and Matching with Params
filterByBoolMask = List.FilterByBoolMask(list=code_block_18.roomsThrough, mask=code_block_20.includedInAnalysis)
flatten_2 = List.Flatten(list=filterByBoolMask.in)

# group: Getting Adjusted Room Centers
code_block_21 = CodeBlock(x=code_block_18.analysisView, y=flatten_2) { activeView = x[0]; roomsInActiveView = DSCore.List.Flatten(y,-1); offsetIntoRoom = 2; }
get_room_centers_error_proof = Python(IN[0]=code_block_21.activeView, IN[1]=code_block_21.roomsInActiveView, IN[2]=code_block_21.offsetIntoRoom)
# ---------- get_room_centers_error_proof.python (207 lines) ----------
# Enable Python support and load DesignScript library
import clr
import math
clr.AddReference('ProtoGeometry')
from Autodesk.DesignScript.Geometry import *

clr.AddReference('RevitNodes')
import Revit
clr.ImportExtensions(Revit.Elements)

clr.ImportExtensions(Revit.GeometryConversion)

clr.AddReference('RevitServices')
import RevitServices
from RevitServices.Persistence import DocumentManager
from RevitServices.Transactions import TransactionManager
from System.Collections.Generic import *

clr.AddReference('RevitAPI')
import Autodesk
from Autodesk.Revit.DB import *

clr.AddReference('DSCoreNodes')
import DSCore
from DSCore.List import *

def adjustForCoincidentPoints(listOfPoints):
	for i,pt in enumerate(listOfPoints):
		coincident = False
		for j,pt2 in enumerate(listOfPoints):
			if pt["x"] == pt2["x"] and pt["y"] == pt2["y"] and pt["z"] == pt2["z"]:
				coincident = True
				break
		if coincident:
			originalPoint = XYZ(pt["x"],pt["y"],pt["z"]).ToPoint()
			destinationPoint = XYZ(listOfPoints[i-1]["x"],listOfPoints[i-1]["y"],listOfPoints[i-1]["z"]).ToPoint()
			translationVector = Vector.ByTwoPoints(originalPoint,destinationPoint)
			newPointGeom = Geometry.Translate(originalPoint,translationVector,0.1)
			newPointObj = dict()
			newPointObj["x"] = newPointGeom.X
			newPointObj["y"] = newPointGeom.Y
			newPointObj["z"] = newPointGeom.Z
			listOfPoints[i] = newPointObj
	return listOfPoints
			
	

def get_bbox_center_pt(bbox):
    """ Returns center XYZ of BoundingBox Element"""
    avg_x = (bbox.Min.X + bbox.Max.X) / 2
    avg_y = (bbox.Min.Y + bbox.Max.Y) / 2
    avg_z = bbox.Min.Z + (bbox.Max.Z-bbox.Min.Z)/2
    return XYZ(avg_x, avg_y, avg_z)

def get_bbox_min_pt(bbox):
    """ Returns center XYZ of BoundingBox Element"""
    min_x = bbox.Min.X
    min_y = bbox.Min.Y
    min_z = bbox.Min.Z
    return XYZ(min_x, min_y, min_z)
    
def get_bbox_max_pt(bbox):
    """ Returns center XYZ of BoundingBox Element"""
    max_x = bbox.Max.X
    max_y = bbox.Max.Y
    max_z = bbox.Max.Z
    return XYZ(max_x, max_y, max_z)

def get_bbox_elevation(bbox):
	min_z = bbox.Min.Z
	return min_z

doc = DocumentManager.Instance.CurrentDBDocument
uiapp = DocumentManager.Instance.CurrentUIApplication
app = uiapp.Application
uidoc = DocumentManager.Instance.CurrentUIApplication.ActiveUIDocument

"""
This python script takes three inputs.
1 - the selected view that the rooms were taken from (typically the active view)
2 - the selected rooms (typically all rooms in active view)
3 - the distance that bounding box centers should be offset into a room when being adjusted
	these centers will only be adjusted if they are found to be outside of a room
"""
selectedView = UnwrapElement(IN[0])
rooms = UnwrapElement(IN[1])
offsetIntoRoom = IN[2]
elevation = selectedView.GenLevel.Elevation

"""
The first portion of this script goes through each room in the input rooms and pulls certain data into a dictionary
This data includes
1. the room itself
2. the room's bounding box
3. the bounding box center
4. the boundary segments as API objects
5. the boundary curves in an unstructured list as Dynamo objects (for representation purposes only)
6. the point coordinates of every start point or divided curve along the room paths (for drawing polygons)
"""

roomGeometries = []
reportingCurves = []
for i, room in enumerate(rooms):
	if room.Area > 0:
		roomGeom = dict()
		roomGeom["room"] = room
		roomGeom["bounding box"] = room.get_BoundingBox(selectedView)
		
		roomGeom["bounding min"] = get_bbox_min_pt(roomGeom["bounding box"]).ToPoint()
		roomGeom["bounding max"] = get_bbox_max_pt(roomGeom["bounding box"]).ToPoint()
		roomGeom["bounding center"] = get_bbox_center_pt(roomGeom["bounding box"]).ToPoint()
		
		roomGeom["elevation"] = get_bbox_elevation(roomGeom["bounding box"])
		roomGeom["boundary curves"] = room.GetBoundarySegments(SpatialElementBoundaryOptions())
		roomGeom["loop points"] = []
		roomGeom["reporting curves"] = []
		for i,curveLoop in enumerate(roomGeom["boundary curves"]):
			loopStartPoints = []
			for curve in curveLoop:
				curveGeom = curve.GetCurve()
				
				roomGeom["reporting curves"].append(curveGeom.ToProtoType())
				curveType = curveGeom.GetType().ToString()
				
				if curveType == "Autodesk.Revit.DB.Line":
					pointDict = dict()
					startPoint = curveGeom.GetEndPoint(0)
					pointDict["x"] = round(startPoint.X,5)
					pointDict["y"] = round(startPoint.Y,5)
					pointDict["z"] = roomGeom["elevation"]
					loopStartPoints.append(pointDict)
					
				else:
					#the logic to run if the line is curved to generate approximating straight segment geometry				
					evalParams = []
					aproxDivisionDistance = 0.5
					numberOfSteps = math.ceil(curveGeom.Length/aproxDivisionDistance)
					paramStep = 1/numberOfSteps
					for step in range(int(numberOfSteps)):
						evalParams.append((step)*paramStep)
						
					for param in evalParams:
						pointDict = dict()
						evalPoint = curveGeom.Evaluate(param,True)
						pointDict["x"] = round(evalPoint.X,5)
						pointDict["y"] = round(evalPoint.Y,5)
						pointDict["z"] = roomGeom["elevation"]
						loopStartPoints.append(pointDict)
						
			roomGeom["loop points"].append(loopStartPoints)
		
		roomGeometries.append(roomGeom)

"""
The geometry sets calculated above are then used to check if each boundary center is inside of the room itself
In cases where the center is in the room it is passed through to the adjusted center key of the dict
In cases where the center is not in the room, the nearest loop is found using Dynamo Core functions, and the
original center is moved along a vector to the closest point on the nearest loop plus the distance set in the inputs
"""

itemsToRemove = []
for geomSet in roomGeometries:
	try:
		centerInRoom = geomSet["room"].IsPointInRoom(geomSet["bounding center"].ToXyz())
		geomSet["center in room"] = centerInRoom
		if centerInRoom:
			geomSet["adjusted center"] = geomSet["bounding center"]
		else:
			closestDistance = 1000000
			for i,loop in enumerate(geomSet["loop points"]):
				loopPoints = []
				loop = adjustForCoincidentPoints(loop)
				for point in loop:
					loopPoints.append(XYZ(point["x"],point["y"],point["z"]).ToPoint())
				loopPolygon = Polygon.ByPoints(loopPoints)
				
				distance = Geometry.DistanceTo(geomSet["bounding center"],loopPolygon)
				if distance < closestDistance:
					closestDistance = distance
					closestLoop = loopPolygon
			closestLoopPoint = Geometry.ClosestPointTo(closestLoop, geomSet["bounding center"])
			vectorToLoop = Vector.ByTwoPoints(geomSet["bounding center"],closestLoopPoint)
			distanceToLoop = vectorToLoop.Length
			geomSet["adjusted center"] = Geometry.Translate(geomSet["bounding center"],vectorToLoop,distanceToLoop + offsetIntoRoom)
	except:
		itemsToRemove.append(geomSet)

for item in itemsToRemove:
	roomGeometries.remove(item)

	

"""
The temporary polygon and points are disposed of to prevent memory problems
"""
try:
	loopPolygon.Dispose()
	for point in loopPoints:
		point.Dispose()
except:
	"no loop polygon was defined"

"""
The full geometry dictionary is returned
"""

OUT = roomGeometries
# ----------------------------------------
code_block_22 = CodeBlock { "adjusted center"; }
valueAtKey = DesignScript.Builtin.Dictionary.ValueAtKey(dictionary=get_room_centers_error_proof, key=code_block_22)
code_block_23 = CodeBlock { "room"; }
valueAtKey_2 = DesignScript.Builtin.Dictionary.ValueAtKey(dictionary=get_room_centers_error_proof, key=code_block_23)
code_block_24 = CodeBlock { "reporting curves"; }
valueAtKey_3 = DesignScript.Builtin.Dictionary.ValueAtKey(dictionary=get_room_centers_error_proof, key=code_block_24)

# group (continued): Pairing Down Rooms and Matching with Params
getParameterValueByName_3 = Element.GetParameterValueByName(element=valueAtKey_2, parameterName=code_block_18.analysisCodeParam@L1)
code_block_25 = CodeBlock(paramVal=getParameterValueByName_3, startVal=code_block_18.startCode, endVal=code_block_18.endCode) { isStartPoint = DSCore.List.Flatten(paramVal == startVal,-1); isEndPoint = DSCore.List.Flatten(paramVal == endVal,-1); }

# group: Applying Shortest Distances
code_block_26 = CodeBlock(IN=code_block_18.analysisView) { activeView = IN; }
filterByBoolMask_2 = List.FilterByBoolMask(list=valueAtKey, mask=code_block_25.isStartPoint)
flatten_3 = List.Flatten(list=filterByBoolMask_2.in)
flatten_4 = List.Flatten(list=filterByBoolMask_2.out)
code_block_27 = CodeBlock(x=code_block_18.drawOnlyShortestPaths) { drawOnlyShortest = x; }
filterByBoolMask_3 = List.FilterByBoolMask(list=valueAtKey_2, mask=code_block_25.isStartPoint)
flatten_5 = List.Flatten(list=filterByBoolMask_3.in)
code_block_28 = CodeBlock(x=code_block_18.deleteExistingPaths) { deleteExistingPaths = x; }
flatten_6 = List.Flatten(list=filterByBoolMask_3.out)
python_script_2 = Python(IN[0]=code_block_26, IN[1]=flatten_3, IN[2]=flatten_4, IN[3]=code_block_27, IN[4]=flatten_5, IN[5]=code_block_28, IN[6]=flatten_6, IN[7]=code_block_18.analysisOutputParam)
# ---------- python_script_2.python (151 lines) ----------
# Enable Python support and load DesignScript library
import clr
clr.AddReference('ProtoGeometry')
from Autodesk.DesignScript.Geometry import *

clr.AddReference('RevitNodes')
import Revit
clr.ImportExtensions(Revit.Elements)

clr.ImportExtensions(Revit.GeometryConversion)

clr.AddReference('RevitServices')
import RevitServices
from RevitServices.Persistence import DocumentManager
from RevitServices.Transactions import TransactionManager
from System.Collections.Generic import *

clr.AddReference('RevitAPI')
import Autodesk
from Autodesk.Revit.DB import *
from Autodesk.Revit.DB.Analysis import PathOfTravel

clr.AddReference('DSCoreNodes')
import DSCore
from DSCore.List import *


def uniqueVals(_listInput):
	_listOut = [_listInput[0]]
	for i,_item in enumerate(_listInput):
		if i > 0:
			unique = True
			for _comparison in _listOut:
				if _comparison == _item:
					unique = False
					break
			if unique:
				_listOut.append(_item)
	return _listOut


doc = DocumentManager.Instance.CurrentDBDocument
uiapp = DocumentManager.Instance.CurrentUIApplication
app = uiapp.Application
uidoc = DocumentManager.Instance.CurrentUIApplication.ActiveUIDocument

#the floorplan where the paths will be drawn.  In this case the active view
floorPlan = UnwrapElement(IN[0][0])

#points for data - if there are a different number of points than rooms, things won't work quite right
startPoints = UnwrapElement(IN[1])
endPoints = UnwrapElement(IN[2])

#rooms for data
startRooms = UnwrapElement(IN[4])
endRooms = UnwrapElement(IN[6])
analysisOutputName = IN[7][0]

#switches
deleteExistingPaths = IN[5]
drawOnlyShortest = IN[3]

"""
deletes all existing paths of travel in the view if the switch is active
"""
if deleteExistingPaths:
	TransactionManager.Instance.EnsureInTransaction(doc)
	allTravelPaths = FilteredElementCollector(doc,doc.ActiveView.Id).OfCategory(BuiltInCategory.OST_PathOfTravelLines).ToElements()
	
	for path in allTravelPaths:
		doc.Delete(path.Id)
	TransactionManager.Instance.TransactionTaskDone()

"""
creating a set of travel paths and their associated data pre-formatted for export
to a csv matrix
"""
TransactionManager.Instance.EnsureInTransaction(doc)
analysisData = []
for i,startPt in enumerate(startPoints):

	shortestDistance = 1000000000
	roomPaths = []
	
	for j, endPt in enumerate(endPoints):
		travelPath = PathOfTravel.Create(floorPlan,startPt.ToXyz(),endPt.ToXyz())
		pathData = dict()
		
		if travelPath:
			pathData["valid path"] = True
			pathData["start room"] = startRooms[i]
			pathData["end room"] = endRooms[j]
			pathData["travel path"] = travelPath
			pathData["travel distance"] = travelPath.LookupParameter("Length").AsDouble()
			
		else:
			pathData["valid path"] = False
			pathData["start room"] = startRooms[i]
			pathData["end room"] = endRooms[j]
			pathData["travel path"] = None
			pathData["travel distance"] = None
			
		roomPaths.append(pathData)
		
	for i,data in enumerate(roomPaths):
		if data["valid path"] and data["travel distance"] < shortestDistance:
			shortestDistance = data["travel distance"]
			
	for data in roomPaths:
		if data["valid path"] and data["travel distance"] == shortestDistance:
			data["shortest path"] = True
		else:
			data["shortest path"] = False
			
	analysisData.append(roomPaths)
TransactionManager.Instance.TransactionTaskDone()

"""
modifying the room output parameters to contain the travel distances
"""
TransactionManager.Instance.EnsureInTransaction(doc)
for i, room in enumerate(startRooms):
	unmatched = True
	for j, data in enumerate(analysisData[i]):
		if data["valid path"] and data["shortest path"]:
			unmatched = False
			room.LookupParameter(analysisOutputName).Set(data["travel distance"])
			break
	if unmatched:
		room.LookupParameter(analysisOutputName).Set(100000)
TransactionManager.Instance.TransactionTaskDone()


"""
deleting all but the shortest paths if the switch is activated
"""

if drawOnlyShortest:
	TransactionManager.Instance.EnsureInTransaction(doc)
	
	for roomPaths in analysisData:
		for travelPath in roomPaths:
			if travelPath["valid path"] and not travelPath["shortest path"]:
				pathElement = travelPath["travel path"].Id
				travelPath["travel path"] = None
				doc.Delete(pathElement)
				
	
	TransactionManager.Instance.TransactionTaskDone()

OUT = analysisData
# ----------------------------------------

# group: Logging Script Runs
replace_with_specific_metrics = CodeBlock { true; 0; 0; 0; "deployed"; }
code_block_29 = CodeBlock(roomsPassthrough=python_script_2) { x = roomsPassthrough; }
logger_input_documentation = CodeBlock(ActivationSwitch=replace_with_specific_metrics.out0, DynamoElementsUpdated=code_block_29, EstimatedTimeSavedEachRun=replace_with_specific_metrics.out2, EstimatedAdditionalTimeSavedPerElement=replace_with_specific_metrics.out3, ScriptStatus=replace_with_specific_metrics.out4)
# ---------- logger_input_documentation.designscript (16 lines) ----------
//Activation Switch.  JSON's will only be written if this is set to true
ActivationSwitch;

//Dyn Elements Updated can be a list or a number
DynamoElementsUpdated;

//The time saved by running script not dependant on number of elements impacted
EstimatedTimeSavedEachRun;

//The time saved by running script that varied by number of elements impacted
EstimatedAdditionalTimeSavedPerElement;

//Script Status.  The script status is a string that will be written to the JSON
//set this status to "testing", "deployed", or a statement that accurately
//describes the current status of the script
ScriptStatus;
# ----------------------------------------
python_logging_script = Python(IN[0]=logger_input_documentation.ActivationSwitch, IN[1]=logger_input_documentation.DynamoElementsUpdated, IN[2]=logger_input_documentation.EstimatedTimeSavedEachRun, IN[3]=logger_input_documentation.EstimatedAdditionalTimeSavedPerElement, IN[4]=logger_input_documentation.ScriptStatus)
# ---------- python_logging_script.python (435 lines) ----------
"""

Export DATA to Server for Dynamo Usage Tracking

-

a dynamoPython script, visit the website for more details

https://github.com/Amoursol/dynamoPython

"""

__author__ = 'Timon Hazell'

__twitter__ = '@tmnhzll'

__github__ = '@thazell'

__version__ = '1.0.0'


__editor__ = 'Dustin Schipper'
__editsdate__ = '12/11/2019'
"""

#The purpose of this script is to allow users to track usage of dynamo.

#The user needs to set the directory below and then it can be copied to all the scripts in the office.

#It will create a single json or CSV per dynamo run (so expect tons of files)

#The single file per run was selected to limit issues with writing to the same file, which occurred on the creators' network.

#Note if a script runs 30x in one session, each run will be logged, so consider that when working.

"""



# 

# ------------------Header - Import Section

import sys

import clr

from System.Reflection import Assembly

dynamo = Assembly.Load('DynamoCore')
dynamoVersion = dynamo.GetName().Version



sys.path.append(r'C:\Program Files (x86)\IronPython 2.7\Lib')

import os  



# Adding the DynamoRevitDS.dll module to work with the Dynamo API

clr.AddReference('DynamoRevitDS')

import Dynamo 



# Import RevitAPI

clr.AddReference("RevitAPI")

import Autodesk

from Autodesk.Revit import DB



# Import DocumentManager and TransactionManager

clr.AddReference("RevitServices")

import RevitServices

from RevitServices.Persistence import DocumentManager





doc = DocumentManager.Instance.CurrentDBDocument

uiapp = DocumentManager.Instance.CurrentUIApplication

app = uiapp.Application



try:

    runscript = IN[0]

except:

    runscript = True



if runscript:



    #----------------Stored Variables Section



    # -->>>> update this string below to a network folder that all users have write access to

    networkFolder = r'\\cga\Data\General\Dept\Bim\Dynamo\01_LoggingDynamoScripts\01_OutputLogs'+os.sep



    #Time saveed is assumed based on the following example:

    #If you expect that every time you renumber sheets you save 5 minutes, but if you renumber 500 sheets you save 5 minutes + 10 seconds per sheet * 500 sheets)

    #edit the following values for each script as an estimate.

    estimatedtimesavedeachrun = IN[2] #put the number of seconds this script will save the office every time it runs

    timesavedperelement = IN[3] #put the number of seconds this script will save for every element that gets edited. 





    releasedOrTesting = IN[4]

    exportAsJson = True #choose whether to record as a json (True) or csv (False)



    #try:

    import datetime

    #add date and time to and central file name subdirectory





    #--------------------Processing Section



    #get current time of dynamo run

    dtstampstring = str(datetime.datetime.today())



    #get computername of run

    computername = os.environ['COMPUTERNAME']



    #get windows username

    username = os.environ['USERNAME']



    #get dynamo filename



    # access to the current Dynamo instance and workspace

    dynamoRevit = Dynamo.Applications.DynamoRevit()

    currentWorkspace = dynamoRevit.RevitDynamoModel.CurrentWorkspace



    # access current version of dynamo

    version=dynamoRevit.RevitDynamoModel.Version



    # checks version of dynamo and adjusts output according to version

    if version.StartsWith("1."):



        # Gets file name which includes full path

        filename=currentWorkspace.FileName

        # Splits out file path to just file name

        dynamoFileName=filename.Split("\\")[-1].Replace(".dyn","")



    elif version.StartsWith("2."):

        dynamoFileName=currentWorkspace.Name

    else:

        dynamoFileName="Unkown"



    #get revit projectnumber

    projectnumber = doc.ProjectInformation.Number



    #get revit projectname

    projectname = doc.ProjectInformation.Name



    #get revit year

    revitYear = app.VersionNumber



    #get full revit version

    revitfullversion = app.VersionBuild



    #get revit saved filename or use 

    try:

        rvtfilename = doc.Title

    except:

        rvtfilename = "Unkown" # file may not be saved

        

    #calculate time saved per run:

    #current time saves per run is just an estimate.  

    #The user can use the following code if they want to count the number of elements 

    #that were processed in dynamo

    # and use that list to figure out the time savings per element

    try:

        dynamoelementsupdated = IN[1]

        if isinstance(dynamoelementsupdated,list):

            elementsupdated = len(dynamoelementsupdated)

        elif isinstance(dynamoelementsupdated, int):

            elementsupdated = dynamoelementsupdated

        elif isintance(dynamoelementsupdated, float):

            elementsupdated = dynamoelementsupdated

        elif   isintance(dynamoelementsupdated, str):

            elementsupdated = int(dynamoelementsupdated)

        else:

            elementsupdated = 0

    except:

        elementsupdated = 0



    timeSavedPerRun = estimatedtimesavedeachrun + timesavedperelement * elementsupdated

    #--------------------Output Section





    #create a dictionary which will be sent to a seperate file for each dynamo run

    outputdictionary = {}

    outputdictionary["Computer"] = str(computername)

    outputdictionary["DynamoFile"] = str(dynamoFileName)

    outputdictionary["Project Name"] = str(projectname)

    outputdictionary["Project Number"] = str(projectnumber)

    outputdictionary["Active Revit Project File Name"] = str(rvtfilename)

    outputdictionary["Released or Testing"] = str(releasedOrTesting)

    outputdictionary["Revit Version"] = str(revitYear)

    outputdictionary["Revit Version Full Build"] = str(revitfullversion)

    outputdictionary["TimeSaved (sec)"] = str(timeSavedPerRun)

    outputdictionary["TimeStamp"] = str(dtstampstring)

    outputdictionary["User"] = str(username)
    
    outputdictionary["Dynamo Version"] = str(dynamoVersion)





    #set directory, create directory if it doesn't exist:

    directory = networkFolder + username + '\\'

        

    if not os.path.exists(directory):

        os.mkdir(directory)

    newfilename = str(datetime.datetime.today()).replace(" ","-").replace(":","-").replace(".","-") + ""





    if exportAsJson:

        import json

        #export json



        newfilename += "-logger.json"

        #create json file.  a new file will be created every time.  This was found to be the most consistent way of getting every run recorded.  

		

        with open(directory+newfilename, 'w') as fp:

            OUT =  outputdictionary

            jsonstring = json.dump(outputdictionary, fp, indent=4)

            #fp.write(jsonstring)   


# code below this point has been commented out as I'm not interested in using the csv formatting

# OUT = [directory,newfilename]
       

#     else:

#         import csv

        

#         newfilename += "-logger.csv"

#         #create json file.  a new file will be created every time.  This was found to be the most consistent way of getting every run recorded.  



        

#         with open(directory + newfilename, 'wb') as csvfile:

#                 spamwriter = csv.writer(csvfile, delimiter=',', quotechar='|', quoting=csv.QUOTE_MINIMAL)

#                 fieldnames = outputdictionary.keys()

#                 writer = csv.DictWriter(csvfile, fieldnames=fieldnames)

#                 writer.writeheader()  

#                 writer.writerow(outputdictionary)





#     outputpreviewlist = []

#     outputpreviewlist.append("The following was recorded to file:")

#     outputpreviewlist.append(directory + newfilename)

#     for title in outputdictionary.keys():

#         outputpreviewlist.append("{0}: {1}".format(title,outputdictionary[title]))

#     OUT = [outputpreviewlist,elementsupdated]



    #if you want to see the output file, uncomment the following lines of code.

    #import subprocess

    #os.startfile(directory + newfilename)



    #-----------------Some code was based on work and questions on the forums by these people, thank you

    #John Pierson

    #Brendan Cassidy
# ----------------------------------------

watch = Watch(code_block_18.analysisView)
code_block_30 = CodeBlock { "adjusted center"; }
valueAtKey_4 = DesignScript.Builtin.Dictionary.ValueAtKey(dictionary=get_room_centers_error_proof, key=code_block_30)
